# Grasshopper definition FEM_Models_Grasshopper.gh (Grasshopper 1.0.7)
# plug-ins: Bifocals, Karamba3D, TT Toolbox, Human, MeshEdit Components

license = LicenseKaramba3D()
panel = Panel(license)
# Rn0.25
rn = Slider(0.25, range=0..1)
# Rn0.50
rn_2 = Slider(0.5, range=0..1)
# Rn0.00
rn_3 = Slider(0, range=0..1)
# Rn0.25
rn_4 = Slider(0.25, range=0..1)
# Rn0.50
rn_5 = Slider(0.5, range=0..1)
# Rn0.00
rn_6 = Slider(0, range=0..1)

# ----
# Construct Umbrella
cluster = Cluster(y=rn, B=rn)

# ----
# Construct Umbrella
cluster_2 = Cluster(y=rn_3, B=rn_3)

# ----
# Construct Umbrella
cluster_3 = Cluster(y=rn_2, B=rn_2)

# ----
# Construct Umbrella
cluster_4 = Cluster(y=rn_4, B=rn_4)

# ----
# Construct Umbrella
cluster_5 = Cluster(y=rn_6, B=rn_6)

# ----
# Construct Umbrella
cluster_6 = Cluster(y=rn_5, B=rn_5)

probepointsres = Slider(15, range=4..20)
probepointsres_2 = Slider(15, range=4..20)
probepointsres_3 = Slider(15, range=4..20)
probepointsres_4 = Slider(15, range=4..20)
probepointsres_5 = Slider(15, range=4..20)
probepointsres_6 = Slider(15, range=4..20)

# ----
# Pressure from DualSPHysics
panel_2 = Panel("""0.0
22489.3
22731.0
23299.2
23537.2
23364.1
23176.8
23102.7
22986.4
22799.8
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""")

pt = ConstructPoint(XCoordinate=Slider(40, range=0..100), YCoordinate=0, ZCoordinate=0)

# ----
# Pressure from DualSPHysics
panel_3 = Panel("""0.0
23361.9
23916.2
24335.0
24257.4
24173.9
24220.2
24298.2
24260.1
24280.4
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""")

xy = XYPlane(Origin=pt)
yz = YZPlane(Origin=pt)

# ----
# Pressure from DualSPHysics
panel_4 = Panel("""0.0
22273.0
22339.9
23014.1
23030.4
23164.8
22469.8
22236.8
21493.9
21322.2
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""")

pt_2 = ConstructPoint(XCoordinate=Slider(40, range=0..100), YCoordinate=0, ZCoordinate=0)
xy_2 = XYPlane(Origin=pt_2)

# ----
# Pressure from DualSPHysics
panel_5 = Panel("""12550.4
14891.8
15678.5
15742.4
15909.6
16450.5
17297.2
16900.4
16775.8
16902.7
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""")

yz_2 = YZPlane(Origin=pt_2)
pt_3 = ConstructPoint(XCoordinate=Slider(40, range=0..100), YCoordinate=0, ZCoordinate=0)

# ----
# Pressure from DualSPHysics
panel_6 = Panel("""7282.38
15037.1
17676.4
16653.4
17161.9
16868.7
16902.6
16801.1
16691.6
16759.9
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""")

xy_3 = XYPlane(Origin=pt_3)
yz_3 = YZPlane(Origin=pt_3)

# ----
# Pressure from DualSPHysics
panel_7 = Panel("""13873.1
15223.5
15450.0
15484.0
15404.2
15060.7
14909.1
15587.5
16209.2
15427.0
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""")

pt_4 = ConstructPoint(XCoordinate=Slider(40, range=0..100), YCoordinate=0, ZCoordinate=0)
xy_4 = XYPlane(Origin=pt_4)
yz_4 = YZPlane(Origin=pt_4)
bnd = Bounds(Numbers=panel_3)
remap = RemapNumbers(Value=panel_3, Source=bnd, Target=Domain(0, 1))  # -> Mapped, Clipped
gradient = Gradient(
    LowerLimit=0,
    UpperLimit=1,
    Parameter=remap.Mapped,
    stops=[0: RGB(247, 250, 255), 0.0312: RGB(240, 246, 252), 0.0625: RGB(234, 242, 250), 0.0938: RGB(228, 238, 248), 0.125: RGB(221, 234, 246), 0.156: RGB(215, 230, 244)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])
mcol = MeshColours(Colours=[RGB(127, 255, 0), RGB(0, 100, 0), RGB(34, 139, 34), RGB(124, 252, 0), RGB(154, 205, 50), RGB(173, 255, 47), RGB(50, 205, 50), RGB(152, 251, 152)])
bnd_2 = Bounds(Numbers=panel_6)
remap_2 = RemapNumbers(Value=panel_6, Source=bnd_2, Target=Domain(0, 1))  # -> Mapped, Clipped
gradient_2 = Gradient(
    LowerLimit=0,
    UpperLimit=1,
    Parameter=remap_2.Mapped,
    stops=[0: RGB(247, 250, 255), 0.0312: RGB(240, 246, 252), 0.0625: RGB(234, 242, 250), 0.0938: RGB(228, 238, 248), 0.125: RGB(221, 234, 246), 0.156: RGB(215, 230, 244)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])
mcol_2 = MeshColours(Colours=[RGB(127, 255, 0), RGB(0, 100, 0), RGB(34, 139, 34), RGB(124, 252, 0), RGB(154, 205, 50), RGB(173, 255, 47), RGB(50, 205, 50), RGB(152, 251, 152)])
delta = Slider(3, range=1..5)
delta_2 = Slider(0, range=0..2)
delta_3 = Slider(3, range=1..5)
delta_4 = Slider(0, range=0..2)
_0_for_analysis_3_for_probing = ItemSelector([delta_2, delta], {"0", "3"}, selected="0")

# ----
# Move to Location
cluster_7 = Cluster_2(G=cluster, y=_0_for_analysis_3_for_probing)

# ----
# Extract Points
cluster_8 = Cluster_3(S=cluster_7, U=probepointsres, V=probepointsres)  # -> T_2, M, relay, relay_2, L, T_3, T

# ----
# https://abaqus-docs.mit.edu/2017/English/SIMACAEGSARefMap/simagsa-c-shlform.htm
# Area Per Quad
area = MeshArea(Mesh=cluster_8.M)  # -> Area, Centroid
item = ListItem(List=area.Area, Index=0, Wrap=True)
sqr = Square(Value=probepointsres)
division = Division(A=item, B=sqr)
panel_8 = Panel(division)

# ----
# Calculate Force (kN)
multiplication = Multiplication(A=flatten(cluster_8.relay_2), B=panel_2, C=division)
expression = Expression(x=multiplication, Expression="x/1000")

# ----
# Pressure Points
panel_9 = Panel(cluster_8.T_2)

# ----
# Cross-Section and Material
thickness = Slider(25, range=0..100)
cluster_9 = Cluster_4(x=probepointsres, S=cluster_7, height=thickness)  # -> elem, M, crosec

# ----
# Apply Load
rev = Reverse(Vector=expression)

# ----
# Number of Points
number_slider = Slider(0.05, range=0..0.1)
points = PointList(Points=flatten(cluster_8.relay), Size=number_slider)
vdis = VectorDisplay(Anchor=cluster_8.relay, Vector=cluster_8.relay_2)
panel_10 = Panel(cluster_8.L)

# ---- group: Loads (Karamba3D)
loads = LoadsKaramba3D(ForceVector=rev, Local=False, PosInd=cluster_8.T, mode="Point")

# ----
_0_for_analysis_3_for_probing_2 = ItemSelector([delta_4, delta_3], {"0", "3"}, selected="0")

# ----
# Move to Location
cluster_10 = Cluster_2(G=cluster_2, y=_0_for_analysis_3_for_probing_2)

cluster_11 = Cluster_6(C=cluster_10, G=cluster_10)  # -> M, G_2
preview = CustomPreview(Geometry=[cluster_11.M, cluster_11.G_2], Material=ColourSwatch(SwatchColor=RGB(178, 178, 178)))

# ----
# Extract Points
cluster_12 = Cluster_3(S=cluster_10, U=probepointsres_2, V=probepointsres_2)  # -> T_2, M, relay, relay_2, L, T_3, T

explode = MeshExplode(Mesh=cluster_12.M, Interpolate=False)  # -> flatten(Faces)
# https://abaqus-docs.mit.edu/2017/English/SIMACAEGSARefMap/simagsa-c-shlform.htm
preview_2 = CustomPreview(Geometry=explode, Shader=gradient)

# ----
# Area Per Quad
cluster_13 = Cluster_5(M=cluster_12.M, x=probepointsres_2)
panel_11 = Panel(cluster_13)

# ----
# Calculate Force (kN)
multiplication_2 = Multiplication(A=flatten(cluster_12.relay_2), B=panel_3, C=cluster_13)
expression_2 = Expression(x=multiplication_2, Expression="x/1000")

# ----
# Pressure Points
panel_12 = Panel(cluster_12.T_2)

# ----
# Cross-Section and Material
thickness_2 = Slider(25, range=0..100)
cluster_14 = Cluster_4(x=probepointsres_2, S=cluster_10, height=thickness_2)  # -> elem, M, crosec

# ----
# Apply Load
rev_2 = Reverse(Vector=expression_2)

# ----
# Number of Points
number_slider_2 = Slider(0.05, range=0..0.1)
points_2 = PointList(Points=flatten(cluster_12.relay), Size=number_slider_2)
vdis_2 = VectorDisplay(Anchor=cluster_12.relay, Vector=cluster_12.relay_2)
panel_13 = Panel(cluster_12.L)

# ---- group: Loads (Karamba3D)
loads_2 = LoadsKaramba3D(ForceVector=rev_2, Local=False, PosInd=cluster_12.T, mode="Point")

# ----
delta_5 = Slider(3, range=1..5)
delta_6 = Slider(0, range=0..2)

# ----
# Normal Vectors
panel_14 = Panel(cluster_8.T_3)

delta_7 = Slider(3, range=1..5)
delta_8 = Slider(0, range=0..2)

# ----
# T = 6 sec
# Normal Vectors
panel_15 = Panel(cluster_12.T_3)

delta_9 = Slider(3, range=1..5)
delta_10 = Slider(0, range=0..2)
_0_for_analysis_3_for_probing_3 = ItemSelector([delta_6, delta_5], {"0", "3"}, selected="0")

# ----
# Move to Location
cluster_15 = Cluster_2(G=cluster_3, y=_0_for_analysis_3_for_probing_3)

# ----
# Extract Points
cluster_16 = Cluster_3(S=cluster_15, U=probepointsres_3, V=probepointsres_3)  # -> T_2, M, relay, relay_2, L, T_3, T

# ----
# https://abaqus-docs.mit.edu/2017/English/SIMACAEGSARefMap/simagsa-c-shlform.htm
# Area Per Quad
area_2 = MeshArea(Mesh=cluster_16.M)  # -> Area, Centroid
item_2 = ListItem(List=area_2.Area, Index=0, Wrap=True)
sqr_2 = Square(Value=probepointsres_3)
division_2 = Division(A=item_2, B=sqr_2)
panel_16 = Panel(division_2)

# ----
# Calculate Force (kN)
multiplication_3 = Multiplication(A=flatten(cluster_16.relay_2), B=panel_4, C=division_2)
expression_3 = Expression(x=multiplication_3, Expression="x/1000")

# ----
# Pressure Points
panel_17 = Panel(cluster_16.T_2)

# ----
# Cross-Section and Material
thickness_3 = Slider(25, range=0..100)
cluster_17 = Cluster_4(x=probepointsres_3, S=cluster_15, height=thickness_3)  # -> elem, M, crosec

# ----
# Apply Load
rev_3 = Reverse(Vector=expression_3)

# ----
# Number of Points
number_slider_3 = Slider(0.05, range=0..0.1)
points_3 = PointList(Points=flatten(cluster_16.relay), Size=number_slider_3)
vdis_3 = VectorDisplay(Anchor=cluster_16.relay, Vector=cluster_16.relay_2)
panel_18 = Panel(cluster_16.L)

# ---- group: Loads (Karamba3D)
loads_3 = LoadsKaramba3D(ForceVector=rev_3, Local=False, PosInd=cluster_16.T, mode="Point")

# ----
_0_for_analysis_3_for_probing_4 = ItemSelector([delta_8, delta_7], {"0", "3"}, selected="0")

# ----
# Move to Location
cluster_18 = Cluster_2(G=cluster_4, y=_0_for_analysis_3_for_probing_4)

# ----
# Extract Points
cluster_19 = Cluster_3(S=cluster_18, U=probepointsres_4, V=probepointsres_4)  # -> T_2, M, relay, relay_2, L, T_3, T

# ----
# https://abaqus-docs.mit.edu/2017/English/SIMACAEGSARefMap/simagsa-c-shlform.htm
# Area Per Quad
area_3 = MeshArea(Mesh=cluster_19.M)  # -> Area, Centroid
item_3 = ListItem(List=area_3.Area, Index=0, Wrap=True)
sqr_3 = Square(Value=probepointsres_4)
division_3 = Division(A=item_3, B=sqr_3)
panel_19 = Panel(division_3)

# ----
# Calculate Force (kN)
multiplication_4 = Multiplication(A=flatten(cluster_19.relay_2), B=panel_5, C=division_3)
expression_4 = Expression(x=multiplication_4, Expression="x/1000")

# ----
# Pressure Points
panel_20 = Panel(cluster_19.T_2)

# ----
# Cross-Section and Material
thickness_4 = Slider(25, range=0..100)
cluster_20 = Cluster_4(x=probepointsres_4, S=cluster_18, height=thickness_4)  # -> elem, M, crosec

# ----
# Apply Load
rev_4 = Reverse(Vector=expression_4)

# ----
# Number of Points
number_slider_4 = Slider(0.05, range=0..0.1)
points_4 = PointList(Points=flatten(cluster_19.relay), Size=number_slider_4)
vdis_4 = VectorDisplay(Anchor=cluster_19.relay, Vector=cluster_19.relay_2)
panel_21 = Panel(cluster_19.L)

# ---- group: Loads (Karamba3D)
loads_4 = LoadsKaramba3D(ForceVector=rev_4, Local=False, PosInd=cluster_19.T, mode="Point")

# ----
# Normal Vectors
panel_22 = Panel(cluster_16.T_3)

# ----
# Boundary Conditions
python = GhPythonScript(x=cluster_9.M)  # -> out, a; inputs x: Mesh
# ---------- python: Python ----------
import Rhino.Geometry as rg

def close_enough(a, b, tolerance=1e-6):
    return abs(a-b) <= tolerance

# Outputs
vertices_matched = []

# If mesh is not None
if x is not None:
    # Iterate over each vertex in the mesh
    for i in range(x.Vertices.Count):
        v = x.Vertices[i]
        z_coord = v.Z
        y_coord = v.Y

        # Check if the vertex's Z and Y coordinates match any of the conditions
        if (close_enough(z_coord, 11.5) or close_enough(z_coord, 6.5)) or (close_enough(y_coord, -2.5) or close_enough(y_coord, 2.5)):
            # If it does, add the vertex to the list of matched vertices
            vertices_matched.append(v)
a = vertices_matched
# ---------- end python ----------
cullduppoints = RemoveDuplicatePoints(InputPoints=flatten(python.a), Tolerance=0.001)  # -> OutputPoints, FirstPointIndexes
supp = SupportKaramba3D(PosInd=cullduppoints.OutputPoints, menu=[buttons(on, on, on, on, on, on)])

_0_for_analysis_3_for_probing_5 = ItemSelector([delta_10, delta_9], {"0", "3"}, selected="0")

# ----
# Move to Location
cluster_21 = Cluster_2(G=cluster_5, y=_0_for_analysis_3_for_probing_5)

cluster_22 = Cluster_6(C=cluster_21, G=cluster_21)  # -> M, G_2
preview_3 = CustomPreview(Geometry=[cluster_22.M, cluster_22.G_2], Material=ColourSwatch(SwatchColor=RGB(178, 178, 178)))

# ----
# Extract Points
cluster_23 = Cluster_3(S=cluster_21, U=probepointsres_5, V=probepointsres_5)  # -> T_2, M, relay, relay_2, L, T_3, T

explode_2 = MeshExplode(Mesh=cluster_23.M, Interpolate=False)  # -> flatten(Faces)
# https://abaqus-docs.mit.edu/2017/English/SIMACAEGSARefMap/simagsa-c-shlform.htm
preview_4 = CustomPreview(Geometry=explode_2, Shader=gradient_2)

# ----
# Area Per Quad
cluster_24 = Cluster_5(M=cluster_23.M, x=probepointsres_5)
panel_23 = Panel(cluster_24)

# ----
# Calculate Force (kN)
multiplication_5 = Multiplication(A=flatten(cluster_23.relay_2), B=panel_6, C=cluster_24)
expression_5 = Expression(x=multiplication_5, Expression="x/1000")

# ----
# Pressure Points
panel_24 = Panel(cluster_23.T_2)

# ----
# Cross-Section and Material
thickness_5 = Slider(25, range=0..100)
cluster_25 = Cluster_4(x=probepointsres_5, S=cluster_21, height=thickness_5)  # -> elem, M, crosec

# ----
# Apply Load
rev_5 = Reverse(Vector=expression_5)

# ----
# Number of Points
number_slider_5 = Slider(0.05, range=0..0.1)
points_5 = PointList(Points=flatten(cluster_23.relay), Size=number_slider_5)
vdis_5 = VectorDisplay(Anchor=cluster_23.relay, Vector=cluster_23.relay_2)
panel_25 = Panel(cluster_23.L)

# ---- group: Loads (Karamba3D)
loads_5 = LoadsKaramba3D(ForceVector=rev_5, Local=False, PosInd=cluster_23.T, mode="Point")

# ----
delta_11 = Slider(3, range=1..5)
delta_12 = Slider(0, range=0..2)

# ----
# Normal Vectors
panel_26 = Panel(cluster_19.T_3)

# ----
# Boundary Conditions
python_2 = GhPythonScript(x=cluster_14.M)  # -> out, a; inputs x: Mesh; same code as python
cullduppoints_2 = RemoveDuplicatePoints(InputPoints=flatten(python_2.a), Tolerance=0.001)  # -> OutputPoints, FirstPointIndexes
supp_2 = SupportKaramba3D(PosInd=cullduppoints_2.OutputPoints, menu=[buttons(on, on, on, on, on, on)])

# ----
# T = 3 sec
# Normal Vectors
panel_27 = Panel(cluster_23.T_3)

_0_for_analysis_3_for_probing_6 = ItemSelector([delta_12, delta_11], {"0", "3"}, selected="0")

# ----
# Move to Location
cluster_26 = Cluster_2(G=cluster_6, y=_0_for_analysis_3_for_probing_6)

# ----
# Extract Points
cluster_27 = Cluster_3(S=cluster_26, U=probepointsres_6, V=probepointsres_6)  # -> T_2, M, relay, relay_2, L, T_3, T

# ----
# https://abaqus-docs.mit.edu/2017/English/SIMACAEGSARefMap/simagsa-c-shlform.htm
# Area Per Quad
area_4 = MeshArea(Mesh=cluster_27.M)  # -> Area, Centroid
item_4 = ListItem(List=area_4.Area, Index=0, Wrap=True)
sqr_4 = Square(Value=probepointsres_6)
division_4 = Division(A=item_4, B=sqr_4)
panel_28 = Panel(division_4)

# ----
# Calculate Force (kN)
multiplication_6 = Multiplication(A=flatten(cluster_27.relay_2), B=panel_7, C=division_4)
expression_6 = Expression(x=multiplication_6, Expression="x/1000")

# ----
# Pressure Points
panel_29 = Panel(cluster_27.T_2)

# ----
# Cross-Section and Material
thickness_6 = Slider(25, range=0..100)
cluster_28 = Cluster_4(x=probepointsres_6, S=cluster_26, height=thickness_6)  # -> elem, M, crosec

# ----
# Apply Load
rev_6 = Reverse(Vector=expression_6)

# ----
# Number of Points
number_slider_6 = Slider(0.05, range=0..0.1)
points_6 = PointList(Points=flatten(cluster_27.relay), Size=number_slider_6)
vdis_6 = VectorDisplay(Anchor=cluster_27.relay, Vector=cluster_27.relay_2)
panel_30 = Panel(cluster_27.L)

# ---- group: Loads (Karamba3D)
loads_6 = LoadsKaramba3D(ForceVector=rev_6, Local=False, PosInd=cluster_27.T, mode="Point")

# ----
# Boundary Conditions
python_3 = GhPythonScript(x=cluster_17.M)  # -> out, a; inputs x: Mesh; same code as python
cullduppoints_3 = RemoveDuplicatePoints(InputPoints=flatten(python_3.a), Tolerance=0.001)  # -> OutputPoints, FirstPointIndexes
supp_3 = SupportKaramba3D(PosInd=cullduppoints_3.OutputPoints, menu=[buttons(on, on, on, on, on, on)])

# ----
# Normal Vectors
panel_31 = Panel(cluster_27.T_3)

# ---- group: Assemble Model (Karamba3D)
assemble = AssembleModelKaramba3D(Elem=cluster_9.elem, Support=supp, Load=loads, CrossSection=cluster_9.crosec, LimitDistance_m=0.005)  # -> Model, Info, Mass_kg, CenterOfGravity

# ----
# Boundary Conditions
python_4 = GhPythonScript(x=cluster_20.M)  # -> out, a; inputs x: Mesh; same code as python
cullduppoints_4 = RemoveDuplicatePoints(InputPoints=flatten(python_4.a), Tolerance=0.001)  # -> OutputPoints, FirstPointIndexes
supp_4 = SupportKaramba3D(PosInd=cullduppoints_4.OutputPoints, menu=[buttons(on, on, on, on, on, on)])

# ---- group: Assemble Model (Karamba3D)
assemble_2 = AssembleModelKaramba3D(Elem=cluster_14.elem, Support=supp_2, Load=loads_2, CrossSection=cluster_14.crosec, LimitDistance_m=0.005)  # -> Model, Info, Mass_kg, CenterOfGravity

# ----
# Boundary Conditions
python_5 = GhPythonScript(x=cluster_25.M)  # -> out, a; inputs x: Mesh; same code as python
cullduppoints_5 = RemoveDuplicatePoints(InputPoints=flatten(python_5.a), Tolerance=0.001)  # -> OutputPoints, FirstPointIndexes
supp_5 = SupportKaramba3D(PosInd=cullduppoints_5.OutputPoints, menu=[buttons(on, on, on, on, on, on)])

# ---- group: Assemble Model (Karamba3D)
assemble_3 = AssembleModelKaramba3D(Elem=cluster_17.elem, Support=supp_3, Load=loads_3, CrossSection=cluster_17.crosec, LimitDistance_m=0.005)  # -> Model, Info, Mass_kg, CenterOfGravity

# ----
# Boundary Conditions
python_6 = GhPythonScript(x=cluster_28.M)  # -> out, a; inputs x: Mesh; same code as python
cullduppoints_6 = RemoveDuplicatePoints(InputPoints=flatten(python_6.a), Tolerance=0.001)  # -> OutputPoints, FirstPointIndexes
supp_6 = SupportKaramba3D(PosInd=cullduppoints_6.OutputPoints, menu=[buttons(on, on, on, on, on, on)])

# ---- group: Assemble Model (Karamba3D)
assemble_4 = AssembleModelKaramba3D(Elem=cluster_20.elem, Support=supp_4, Load=loads_4, CrossSection=cluster_20.crosec, LimitDistance_m=0.005)  # -> Model, Info, Mass_kg, CenterOfGravity

assemble_5 = AssembleModelKaramba3D(Elem=cluster_25.elem, Support=supp_5, Load=loads_5, CrossSection=cluster_25.crosec, LimitDistance_m=0.005)  # -> Model, Info, Mass_kg, CenterOfGravity

assemble_6 = AssembleModelKaramba3D(Elem=cluster_28.elem, Support=supp_6, Load=loads_6, CrossSection=cluster_28.crosec, LimitDistance_m=0.005)  # -> Model, Info, Mass_kg, CenterOfGravity

# ----
# Colors
swatch = ColourSwatch(SwatchColor=RGB(255, 255, 255))
# T = 3 sec
merge = Merge(
    Data1=swatch,
    Data2=ColourSwatch(SwatchColor=RGB(255, 0, 0)),
    Data3=ColourSwatch(SwatchColor=RGB(255, 255, 255)),
    Data4=ColourSwatch(SwatchColor=RGB(27, 137, 247)),
    Data5=ColourSwatch(SwatchColor=RGB(255, 255, 255)))

# ----
# Rectangle
cluster_29 = Cluster_7()

# ----
# Colors
swatch_2 = ColourSwatch(SwatchColor=RGB(255, 255, 255))
merge_2 = Merge(
    Data1=swatch_2,
    Data2=ColourSwatch(SwatchColor=RGB(255, 0, 0)),
    Data3=ColourSwatch(SwatchColor=RGB(255, 255, 255)),
    Data4=ColourSwatch(SwatchColor=RGB(27, 137, 247)),
    Data5=ColourSwatch(SwatchColor=RGB(255, 255, 255)))

# ----
# Rectangle
cluster_30 = Cluster_7()

cluster_31 = Cluster_7()
merge_3 = Merge(
    Data1=ColourSwatch(SwatchColor=RGB(255, 255, 255)),
    Data2=ColourSwatch(SwatchColor=RGB(255, 0, 0)),
    Data3=ColourSwatch(SwatchColor=RGB(255, 255, 255)),
    Data4=ColourSwatch(SwatchColor=RGB(27, 137, 247)),
    Data5=ColourSwatch(SwatchColor=RGB(255, 255, 255)))

# ----
# Colors
swatch_3 = ColourSwatch(SwatchColor=RGB(255, 255, 255))
merge_4 = Merge(
    Data1=swatch_3,
    Data2=ColourSwatch(SwatchColor=RGB(255, 0, 0)),
    Data3=ColourSwatch(SwatchColor=RGB(255, 255, 255)),
    Data4=ColourSwatch(SwatchColor=RGB(27, 137, 247)),
    Data5=ColourSwatch(SwatchColor=RGB(255, 255, 255)))

# ----
# Rectangle
cluster_32 = Cluster_7()

# ----
# Colors
swatch_4 = ColourSwatch(SwatchColor=RGB(255, 255, 255))
merge_5 = Merge(
    Data1=swatch_4,
    Data2=ColourSwatch(SwatchColor=RGB(255, 0, 0)),
    Data3=ColourSwatch(SwatchColor=RGB(255, 255, 255)),
    Data4=ColourSwatch(SwatchColor=RGB(27, 137, 247)),
    Data5=ColourSwatch(SwatchColor=RGB(255, 255, 255)))

# ----
# Colors
swatch_5 = ColourSwatch(SwatchColor=RGB(255, 255, 255))
merge_6 = Merge(
    Data1=swatch_5,
    Data2=ColourSwatch(SwatchColor=RGB(255, 0, 0)),
    Data3=ColourSwatch(SwatchColor=RGB(255, 255, 255)),
    Data4=ColourSwatch(SwatchColor=RGB(27, 137, 247)),
    Data5=ColourSwatch(SwatchColor=RGB(255, 255, 255)))

# ----
# Rectangle
cluster_33 = Cluster_7()

# ----
# Rectangle
cluster_34 = Cluster_7()

panel_32 = Panel("""0.0
22273.0
22339.9
23014.1
23030.4
23164.8
22469.8
22236.8
21493.9
21322.2
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""")
# Rn
rn_7 = Slider(0.5, range=0..1)
delta_13 = Slider(3, range=1..5)
delta_14 = Slider(0, range=0..2)

# ----
# Construct Umbrella
cluster_35 = Cluster(y=rn_7, B=rn_7)

# ----
# Move to Location
_0_for_analysis_3_for_probing_7 = ItemSelector([delta_14, delta_13], {"0", "3"}, selected="3")
# Rn0.50
rn_8 = Slider(0.5, range=0..1)
smoothinglength = Slider(0.207846, range=0..1)
# Z = 9 for Draft = 3.5 m, and Z = 10 for Draft = 2.5 m (it's the distance from sea-bed to hypar vertex).
number_slider_7 = Slider(10, range=0..100)
expression_7 = Expression(x=Slider(40, range=0..100), y=_0_for_analysis_3_for_probing_7, h=smoothinglength, Expression="x - y*h - 5 + 2.5")
panel_33 = Panel(expression_7)
vec = VectorXYZ(XComponent=expression_7, YComponent=Slider(0, range=-5..5), ZComponent=number_slider_7)  # -> Vector, Length
# Probe for SAP2000 Here - Dec 2024
move = Move(Geometry=cluster_35, Motion=vec.Vector)  # -> Geometry, Transform
probepointsres_7 = Slider(15, range=4..20)
# Extract Points
mesh_uv = MeshSurface(Surface=move.Geometry, UCount=probepointsres_7, VCount=probepointsres_7, Overhang=True, Equalize=False)

# ----
# Construct Umbrella
cluster_36 = Cluster(y=rn_8, B=rn_8)

facen = FaceNormals(Mesh=mesh_uv)  # -> Centers, Normals
pdecon = Deconstruct(Point=flatten(facen.Centers))  # -> XComponent, YComponent, ZComponent
flatten = FlattenTree(Tree=facen.Centers, Path="{0}")
expression_8 = Expression(x=pdecon.XComponent, y=pdecon.YComponent, z=pdecon.ZComponent, Expression="-y + z*10000")
flatten_2 = FlattenTree(Tree=facen.Normals, Path="{0}")
lng = ListLength(List=flatten_2)  # -> flatten(Length)
pt_5 = ConstructPoint(XCoordinate=expression_8, YCoordinate=0, ZCoordinate=0)
sort_pt = SortPoints(Points=flatten(pt_5))  # -> Points, Indices
item_5 = ListItem(List=flatten(facen.Centers), Index=sort_pt.Indices, Wrap=True)

# ----
# Number of Points
number_slider_8 = Slider(0.06, range=0..0.1)
points_7 = PointList(Points=flatten(item_5), Size=number_slider_8)
vdis_7 = VectorDisplay(Anchor=facen.Centers, Vector=facen.Normals)
panel_35 = Panel(lng)

pt_6 = ConstructPoint(XCoordinate=Slider(40, range=0..100), YCoordinate=0, ZCoordinate=0)
flatten_3 = FlattenTree(Tree=item_5, Path="{0}")
probepointsres_8 = Slider(15, range=4..20)
xy_5 = XYPlane(Origin=pt_6)
yz_5 = YZPlane(Origin=pt_6)

# ----
# Pressure Points
panel_36 = Panel(flatten_3)

preview_5 = CustomPreview(Geometry=[yz_5, xy_5], Material=ColourSwatch(SwatchColor=RGB(128, 119, 119)))

# ----
# Pressure from DualSPHysics
panel_37 = Panel("""0.0
22273.0
22339.9
23014.1
23030.4
23164.8
22469.8
22236.8
21493.9
21322.2
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""")

pt_7 = ConstructPoint(XCoordinate=Slider(40, range=0..100), YCoordinate=0, ZCoordinate=0)
xy_6 = XYPlane(Origin=pt_7)
yz_6 = YZPlane(Origin=pt_7)

# ----
# Cross-Section and Material
thickness_7 = Slider(25, range=0..100)

delta_15 = Slider(3, range=1..5)
delta_16 = Slider(0, range=0..2)
matselect = MaterialSelectionKaramba3D(menu=[dropdown(1), dropdown(15)])
panel_38 = Panel(matselect)
# Material
number_slider_9 = Slider(1, range=0..1)
cross_section = CrossSectionKaramba3D(FamilyNameOfCrossSection="DefaultCroSec", Material=matselect, Height_cm=number_slider_9, mode="Shell - Const")
_0_for_analysis_3_for_probing_8 = ItemSelector([delta_16, delta_15], {"0", "3"}, selected="0")

# ----
# Move to Location
cluster_37 = Cluster_2(G=cluster_36, y=_0_for_analysis_3_for_probing_8)

# ----
# Extract Points
cluster_38 = Cluster_3(S=cluster_37, U=probepointsres_8, V=probepointsres_8)  # -> T_2, M, relay, relay_2, L, T_3, T

# ----
# https://abaqus-docs.mit.edu/2017/English/SIMACAEGSARefMap/simagsa-c-shlform.htm
# Area Per Quad
area_5 = MeshArea(Mesh=cluster_38.M)  # -> Area, Centroid
item_6 = ListItem(List=area_5.Area, Index=0, Wrap=True)
sqr_5 = Square(Value=probepointsres_8)
division_5 = Division(A=item_6, B=sqr_5)
panel_39 = Panel(division_5)

# ----
# Calculate Force (kN)
multiplication_7 = Multiplication(A=flatten(cluster_38.relay_2), B=panel_37, C=division_5)
expression_9 = Expression(x=multiplication_7, Expression="x/1000")

# ----
# Pressure Points
panel_40 = Panel(cluster_38.T_2)

# ----
# Apply Load
rev_7 = Reverse(Vector=expression_9)

# ----
# Number of Points
number_slider_10 = Slider(0.05, range=0..0.1)
points_8 = PointList(Points=flatten(cluster_38.relay), Size=number_slider_10)
vdis_8 = VectorDisplay(Anchor=cluster_38.relay, Vector=cluster_38.relay_2)
panel_41 = Panel(cluster_38.L)

# ---- group: Loads (Karamba3D)
loads_7 = LoadsKaramba3D(ForceVector=rev_7, Local=False, PosInd=cluster_38.T, mode="Point")

# ----
# Mesh Resolution
expression_10 = Expression(x=probepointsres_8, Expression="2*x")
panel_42 = Panel(expression_10)
mesh_uv_2 = MeshSurface(Surface=cluster_37, UCount=expression_10, VCount=expression_10, Overhang=True, Equalize=False)
meshtoshell = MeshToShellKaramba3D(Mesh=mesh_uv_2, LimitDistance_m=0.005)  # -> Element, Points, Info

number_slider_11 = Slider(1705.43, range=0..10000)

# ----
# Normal Vectors
panel_43 = Panel(cluster_38.T_3)

matprops = MaterialPropertiesKaramba3D(
    FamilyOfMaterial="concrete",
    Name="S235",
    YoungsModulus_kN_cm2=Slider(4400, range=0..10000),
    InPlaneShearModulus_kN_cm2=number_slider_11,
    TransverseShearModulus_kN_cm2=number_slider_11,
    SpecificWeight_kN_m3=Slider(25, range=0..100),
    CoefficientOfThermalExpansion_1_C=1.2e-05,
    TensileStrength_kN_cm2=Slider(0.6, range=0..1),
    CompressiveStrength_kN_cm2="-6",
    StrengthHypothesis="Rankine",
    mode="Isotrop")

# ----
# Boundary Conditions
python_7 = GhPythonScript(x=mesh_uv_2)  # -> out, a; inputs x: Mesh; same code as python
cullduppoints_7 = RemoveDuplicatePoints(InputPoints=flatten(python_7.a), Tolerance=0.001)  # -> OutputPoints, FirstPointIndexes
supp_7 = SupportKaramba3D(PosInd=cullduppoints_7.OutputPoints, menu=[buttons(on, on, on, on, on, on)])

# ---- group: Assemble Model (Karamba3D)
assemble_7 = AssembleModelKaramba3D(Elem=meshtoshell.Element, Support=supp_7, Load=loads_7, CrossSection=cross_section, LimitDistance_m=0.005)  # -> Model, Info, Mass_kg, CenterOfGravity

# ----
# Colors
swatch_6 = ColourSwatch(SwatchColor=RGB(255, 255, 255))
merge_7 = Merge(
    Data1=swatch_6,
    Data2=ColourSwatch(SwatchColor=RGB(255, 0, 0)),
    Data3=ColourSwatch(SwatchColor=RGB(255, 255, 255)),
    Data4=ColourSwatch(SwatchColor=RGB(27, 137, 247)),
    Data5=ColourSwatch(SwatchColor=RGB(255, 255, 255)))

# ----
# Rectangle
cluster_39 = Cluster_7()

# ----
# FEM using Karamba
analyze_karamba3d = AnalyzeKaramba3D(Model=assemble.Model)  # -> CalculatedModel, MaximumDisplacement_cm, ResultingForceOfGravity_kN, ElasticEnergyChange_kNm
model_view_karamba3d = ModelViewKaramba3D(Model=analyze_karamba3d.CalculatedModel, ResultFactors=1, ResultCase=-1, Colors=merge_2)  # -> Model, DeformedMesh, DeformedAxes, DeformedModel
shell_view_karamba3d = ShellViewKaramba3D(Model=model_view_karamba3d.Model, IndexOfLayer=0)  # -> Model, MeshesOfRenderedShells, LegendColors, LegendTags
panel_44 = Panel(shell_view_karamba3d.LegendTags)

# ----
# Legend in MPa
cluster_40 = Cluster_8(L=shell_view_karamba3d.LegendTags)

legend = Legend(Colour=shell_view_karamba3d.LegendColors, Tags=cluster_40, Rectangle=cluster_30, LegendType=1)

panel_45 = Panel(analyze_karamba3d.MaximumDisplacement_cm)

# ----
# FEM using Karamba
analyze_karamba3d_2 = AnalyzeKaramba3D(Model=assemble_2.Model)  # -> CalculatedModel, MaximumDisplacement_cm, ResultingForceOfGravity_kN, ElasticEnergyChange_kNm
model_view_karamba3d_2 = ModelViewKaramba3D(Model=analyze_karamba3d_2.CalculatedModel, ResultFactors=1, ResultCase=-1, Colors=merge)  # -> Model, DeformedMesh, DeformedAxes, DeformedModel
shell_view_karamba3d_2 = ShellViewKaramba3D(Model=model_view_karamba3d_2.Model, IndexOfLayer=0)  # -> Model, MeshesOfRenderedShells, LegendColors, LegendTags

# ----
# Legend in MPa
cluster_41 = Cluster_8(L=shell_view_karamba3d_2.LegendTags)

legend_2 = Legend(Colour=shell_view_karamba3d_2.LegendColors, Tags=cluster_41, Rectangle=cluster_29, LegendType=1)

# ----
# FEM using Karamba
analyze_karamba3d_3 = AnalyzeKaramba3D(Model=assemble_3.Model)  # -> CalculatedModel, MaximumDisplacement_cm, ResultingForceOfGravity_kN, ElasticEnergyChange_kNm
model_view_karamba3d_3 = ModelViewKaramba3D(Model=analyze_karamba3d_3.CalculatedModel, ResultFactors=1, ResultCase=-1, Colors=merge_3)  # -> Model, DeformedMesh, DeformedAxes, DeformedModel
shell_view_karamba3d_3 = ShellViewKaramba3D(Model=model_view_karamba3d_3.Model, IndexOfLayer=0)  # -> Model, MeshesOfRenderedShells, LegendColors, LegendTags
panel_46 = Panel(shell_view_karamba3d_3.LegendTags)

cluster_42 = Cluster_8(L=shell_view_karamba3d_3.LegendTags)

legend_3 = Legend(Colour=shell_view_karamba3d_3.LegendColors, Tags=cluster_42, Rectangle=cluster_31, LegendType=1)

panel_47 = Panel(analyze_karamba3d_3.MaximumDisplacement_cm)

# ----
# FEM using Karamba
analyze_karamba3d_4 = AnalyzeKaramba3D(Model=assemble_4.Model)  # -> CalculatedModel, MaximumDisplacement_cm, ResultingForceOfGravity_kN, ElasticEnergyChange_kNm
model_view_karamba3d_4 = ModelViewKaramba3D(Model=analyze_karamba3d_4.CalculatedModel, ResultFactors=1, ResultCase=-1, Colors=merge_5)  # -> Model, DeformedMesh, DeformedAxes, DeformedModel
shell_view_karamba3d_4 = ShellViewKaramba3D(Model=model_view_karamba3d_4.Model, IndexOfLayer=0)  # -> Model, MeshesOfRenderedShells, LegendColors, LegendTags
panel_48 = Panel(shell_view_karamba3d_4.LegendTags)

# ----
# Legend in MPa
cluster_43 = Cluster_8(L=shell_view_karamba3d_4.LegendTags)

legend_4 = Legend(Colour=shell_view_karamba3d_4.LegendColors, Tags=cluster_43, Rectangle=cluster_33, LegendType=1)

panel_49 = Panel(analyze_karamba3d_4.MaximumDisplacement_cm)

# ----
# FEM using Karamba
analyze_karamba3d_5 = AnalyzeKaramba3D(Model=assemble_5.Model)  # -> CalculatedModel, MaximumDisplacement_cm, ResultingForceOfGravity_kN, ElasticEnergyChange_kNm
model_view_karamba3d_5 = ModelViewKaramba3D(Model=analyze_karamba3d_5.CalculatedModel, ResultFactors=1, ResultCase=-1, Colors=merge_4)  # -> Model, DeformedMesh, DeformedAxes, DeformedModel
shell_view_karamba3d_5 = ShellViewKaramba3D(Model=model_view_karamba3d_5.Model, IndexOfLayer=0)  # -> Model, MeshesOfRenderedShells, LegendColors, LegendTags

# ----
# Legend in MPa
cluster_44 = Cluster_8(L=shell_view_karamba3d_5.LegendTags)

legend_5 = Legend(Colour=shell_view_karamba3d_5.LegendColors, Tags=cluster_44, Rectangle=cluster_32, LegendType=1)

# ----
# FEM using Karamba
analyze_karamba3d_6 = AnalyzeKaramba3D(Model=assemble_6.Model)  # -> CalculatedModel, MaximumDisplacement_cm, ResultingForceOfGravity_kN, ElasticEnergyChange_kNm
model_view_karamba3d_6 = ModelViewKaramba3D(Model=analyze_karamba3d_6.CalculatedModel, ResultFactors=1, ResultCase=-1, Colors=merge_6)  # -> Model, DeformedMesh, DeformedAxes, DeformedModel
shell_view_karamba3d_6 = ShellViewKaramba3D(Model=model_view_karamba3d_6.Model, IndexOfLayer=0)  # -> Model, MeshesOfRenderedShells, LegendColors, LegendTags
panel_50 = Panel(shell_view_karamba3d_6.LegendTags)

# ----
# Legend in MPa
cluster_45 = Cluster_8(L=shell_view_karamba3d_6.LegendTags)

legend_6 = Legend(Colour=shell_view_karamba3d_6.LegendColors, Tags=cluster_45, Rectangle=cluster_34, LegendType=1)

panel_51 = Panel(analyze_karamba3d_6.MaximumDisplacement_cm)

# ----
# FEM using Karamba
analyze_karamba3d_7 = AnalyzeKaramba3D(Model=assemble_7.Model)  # -> CalculatedModel, MaximumDisplacement_cm, ResultingForceOfGravity_kN, ElasticEnergyChange_kNm
model_view_karamba3d_7 = ModelViewKaramba3D(Model=analyze_karamba3d_7.CalculatedModel, ResultFactors=1, ResultCase=-1, Colors=merge_7)  # -> Model, DeformedMesh, DeformedAxes, DeformedModel
shell_view_karamba3d_7 = ShellViewKaramba3D(Model=model_view_karamba3d_7.Model, IndexOfLayer=0)  # -> Model, MeshesOfRenderedShells, LegendColors, LegendTags
panel_52 = Panel(shell_view_karamba3d_7.LegendTags)

# ----
# Legend in MPa
cluster_46 = Cluster_8(L=shell_view_karamba3d_7.LegendTags)

legend_7 = Legend(Colour=shell_view_karamba3d_7.LegendColors, Tags=cluster_46, Rectangle=cluster_39, LegendType=1)

panel_53 = Panel(analyze_karamba3d_7.MaximumDisplacement_cm)

# ==== cluster Cluster
a_0_5_m = Slider(5, range=0..10)
y = ClusterInput()

# ----
# Set Area Constraint
number_slider = Slider(4, range=0..10)
polygon = Polygon(Plane=PlaneXY(0, 0, 0), Radius=3, Segments=number_slider, FilletRadius=0)  # -> Polygon, Length
area = Area(Geometry=polygon.Polygon)  # -> Area, Centroid
sqrt = SquareRoot(Value=area.Area)
division = Division(A=a_0_5_m, B=sqrt)
scale = Scale(Geometry=polygon.Polygon, Center=area.Centroid, Factor=division)  # -> Geometry, Transform

# ----
# Warping, k (m^-1)
expression = Expression(x=a_0_5_m, y=y, Expression="4*y/x")
panel = Panel(expression)

boundary = BoundarySurfaces(Edges=scale.Geometry)
explode = Explode(Curve=scale.Geometry, Recursive=True)  # -> Segments, Vertices
pcen = PolygonCenter(Polyline=scale.Geometry)  # -> CenterV, CenterE, CenterA
area_2 = Area(Geometry=scale.Geometry)  # -> Area, Centroid
midpt = CurveMiddle(Curve=explode.Segments)
panel_2 = Panel(area_2.Area)
ln = Line(StartPoint=pcen.CenterV, EndPoint=midpt)
B = ClusterInput()
srfsplit = SurfaceSplit(Surface=boundary, Curves=ln)
multiplication = Multiplication(A=a_0_5_m, B=B)
debrep = DeconstructBrep(Brep=srfsplit)  # -> Faces, Edges, Vertices
Z = UnitZ(Factor=expr("-x", multiplication))
item = ListItem(List=flatten(debrep.Faces), Index=0, Wrap=True)
debrep_2 = DeconstructBrep(Brep=item)  # -> Faces, Edges, Vertices
item_2 = ListItem(List=flatten(debrep_2.Vertices), Index=1, Wrap=True)
move = Move(Geometry=item_2, Motion=Z)  # -> Geometry, Transform
replace = ReplaceItems(List=debrep_2.Vertices, Item=move.Geometry, Indices=1, Wrap=False)
avr = Average(Input=replace)
cir = Circle(Plane=avr, Radius=0.5)
alongcrv = SortAlongCurve(Points=replace, Curve=cir)  # -> Points, Indices
item_3 = ListItem(List=alongcrv.Points, Index=0, Wrap=True)  # -> Item, Item1, Item2, Item3
range = Range(Domain=Domain(0, 1), Steps=10)
srf4pt = _4PointSurface(CornerA=item_3.Item, CornerB=item_3.Item1, CornerC=item_3.Item2, CornerD=item_3.Item3)
pt = ConstructPoint(XCoordinate=range, YCoordinate=range, ZCoordinate=0)
arrpolar = PolarArray(Geometry=srf4pt, Plane=pcen.CenterV, Count=number_slider, Angle=6.283185307)  # -> Geometry, Transform
iso = IsoCurve(Surface=reparameterize(graft(arrpolar.Geometry)), UVPoint=pt)  # -> UIsocurve, VIsocurve

# ----
# Center Umbrella
debrep_3 = DeconstructBrep(Brep=arrpolar.Geometry)  # -> Faces, Edges, flatten(Vertices)
sortptpolar = SortPointsPolar(Points=debrep_3.Vertices, ReferncePlane=PlaneXY(0, 0, 0))  # -> SortedPoints, SortedValues
item_4 = ListItem(List=flatten(sortptpolar.SortedPoints), Index=Slider(1, range=0..1), Wrap=True)  # -> Item, Item1
angle = Angle(VectorA=item_4.Item, VectorB=item_4.Item1)  # -> Angle, Reflex
rotate = Rotate(Geometry=arrpolar.Geometry, Angle=angle.Angle, Plane=PlaneXY(0, 0, 0))  # -> Geometry, Transform
X = UnitX(Factor=expr("0.5*x", a_0_5_m))
xz = XZPlane(Origin=Point(0, 0, 0))
rotate_2 = Rotate(Geometry=rotate.Geometry, Angle=1.570796327, Plane=xz)  # -> Geometry, Transform
rev = Reverse(Vector=X)
move_2 = Move(Geometry=rotate_2.Geometry, Motion=rev)  # -> Geometry, Transform

G = ClusterOutput(move_2.Geometry)

# ==== cluster Cluster_2
smoothinglength = Slider(0.207846, range=0..1)
y = ClusterInput()
expression = Expression(x=Slider(40, range=0..100), y=y, h=smoothinglength, Expression="x - y*h - 5 + 2.5")
panel = Panel(expression)
vec = VectorXYZ(XComponent=expression, YComponent=Slider(0, range=-5..5), ZComponent=Slider(9, range=0..100))  # -> Vector, Length
G = ClusterInput()
move = Move(Geometry=G, Motion=vec.Vector)  # -> Geometry, Transform
G_2 = ClusterOutput(move.Geometry)

# ==== cluster Cluster_3
S = ClusterInput()
U = ClusterInput()
V = ClusterInput()
mesh_uv = MeshSurface(Surface=S, UCount=U, VCount=V, Overhang=True, Equalize=False)
M = ClusterOutput(mesh_uv)
facen = FaceNormals(Mesh=mesh_uv)  # -> Centers, Normals
flatten = FlattenTree(Tree=facen.Centers, Path="{0}")
relay = ClusterOutput(facen.Centers)
T = ClusterOutput(flatten)
flatten_2 = FlattenTree(Tree=facen.Centers, Path="{0}")
T_2 = ClusterOutput(flatten_2)
flatten_3 = FlattenTree(Tree=facen.Normals, Path="{0}")
relay_2 = ClusterOutput(facen.Normals)
T_3 = ClusterOutput(flatten_3)
lng = ListLength(List=flatten_3)  # -> flatten(Length)
L = ClusterOutput(lng)

# ==== cluster Cluster_4
x = ClusterInput()
S = ClusterInput()

# ----
# Mesh Resolution
expression = Expression(x=x, Expression="2*x")
panel = Panel(expression)
mesh_uv = MeshSurface(Surface=S, UCount=expression, VCount=expression, Overhang=True, Equalize=False)
meshtoshell = MeshToShellKaramba3D(Mesh=mesh_uv, LimitDistance_m=0.005)  # -> Element, Points, Info

# ----
# Material
matselect = MaterialSelectionKaramba3D(menu=[dropdown(7), dropdown(15)])
M = ClusterOutput(mesh_uv)
height = ClusterInput()
cross_section = CrossSectionKaramba3D(FamilyNameOfCrossSection="DefaultCroSec", Material=matselect, Height_cm=height, mode="Shell - Const")
elem = ClusterOutput(meshtoshell.Element)
crosec = ClusterOutput(cross_section)

# ==== cluster Cluster_5
M = ClusterInput()
area = MeshArea(Mesh=M)  # -> Area, Centroid
x = ClusterInput()
item = ListItem(List=area.Area, Index=0, Wrap=True)
sqr = Square(Value=x)
division = Division(A=item, B=sqr)
R = ClusterOutput(division)

# ==== cluster Cluster_6
pt = ConstructPoint(XCoordinate=Slider(40, range=0..100), YCoordinate=0, ZCoordinate=0)
yz = YZPlane(Origin=pt)
G = ClusterInput()
mirror = Mirror(Geometry=G, Plane=yz)  # -> Geometry, Transform
C = ClusterInput()
G_2 = ClusterOutput(mirror.Geometry)
X = UnitX(Factor=1)
bbox = BoundingBox(Content=[mirror.Geometry, C], Plane=PlaneXY(0, 0, 0), UnionBox=True)  # -> Box, Box_2
mbox = MeshBox(Base=bbox.Box, XCount=10, YCount=10, ZCount=10)
facen = FaceNormals(Mesh=mbox)  # -> Centers, Normals
dprod = DotProduct(VectorA=facen.Normals, VectorB=X, Unitize=False)
abs = Absolute(Value=dprod)
equals = Equality(FirstNumber=abs, SecondNumber=Slider(0, range=0..100))  # -> Equality, Inequality
cullf = CullFaces(Mesh=mbox, Pattern=equals.Inequality)
M = ClusterOutput(cullf)

# ==== cluster Cluster_7
Z = UnitZ(Factor=1)
Y = UnitY(Factor=1)  # -> expr("-x", UnitVector)
pl = ConstructPlane(Origin=Point(0, 0, 0), XAxis=Y, YAxis=Z)
rectangle = Rectangle(Plane=pl, XSize=Domain(-1, 1), YSize=Domain(-2, 2), Radius=0)  # -> Rectangle, Length
pt = ConstructPoint(XCoordinate=Slider(33, range=0..100), YCoordinate=Slider(-6, range=-10..10), ZCoordinate=Slider(9, range=0..10))
move = Move(Geometry=rectangle.Rectangle, Motion=pt)  # -> Geometry, Transform
G = ClusterOutput(move.Geometry)

# ==== cluster Cluster_8
L = ClusterInput()
split = SplitList(List=L, Index=Slider(1, range=0..1))  # -> ListA, ListB
relast = RemoveLastItem(List=split.ListB, NumberOfItems=1)
expression = Expression(x=relast, Expression="round(x*10,2)")
merge = Merge(Data1="Stress (MPa)", Data2=expression)  # -> flatten(Result)
R = ClusterOutput(merge)
